% Requirement links of ACS.slx (R2020a)

block :1 implements AccessControl_ref.slreqx#1: Должно быть обеспечено чтение RFID-метки
block :2 implements AccessControl_ref.slreqx#2: Данные извлеченные из RFID-метки должны быть переданы во внешнюю базу данных ODBC
block :2 implements AccessControl_ref.slreqx#3: На основе ответа базы данных вырабатывается запрет или разрешение доступа
block :3 implements AccessControl_ref.slreqx#5: Замок разблокируется на основе статусе доступа
block :4 implements AccessControl_ref.slreqx#4: Пользователь должен быть извещен о статусе доступа