# Requirement set AccessControl_ref (R2020a)

## 1 [#1] Должно быть обеспечено чтение RFID-метки

## 2 [#2] Данные извлеченные из RFID-метки должны быть переданы во внешнюю базу данных ODBC

## 3 [#3] На основе ответа базы данных вырабатывается запрет или разрешение доступа

## 4 [#4] Пользователь должен быть извещен о статусе доступа

## 5 [#5] Замок разблокируется на основе статусе доступа